# Grasshopper definition MBOR_2.gh (Grasshopper 1.0.5)
# plug-ins: GH_CPython

遥感图像路径 = Panel("E:/MBOR_2/7720.jpg")
unet_模型路径 = Panel("E:/MBOR_2/output_inf/UnetPP")
threshold_area = Slider(200, range=0..1000)
threshold_area_simplify = Slider(3, range=0..10)
list = ValueList({"True", "False"}, selected="False")
open_kernel_size = Slider(9, range=0..10)
h_min = Slider(5, range=0..10)
h_max = Slider(44, range=0..100)
zoom = Slider(3, range=0..10)
获取图像大小 = GH_CPython(img_path=遥感图像路径)  # -> size; inputs img_path: list
#   port img_path: [required] - [type = int] - [default = None] Descripe your input here * bullet point. * bullet point
# ---------- 获取图像大小: Python ----------
# -*- coding: utf-8 -*-
import os
import cv2
import numpy as np

img = cv2.imread(img_path)
size = img.shape[0]
# ---------- end 获取图像大小 ----------
建筑物分割 = 基于深度学习的遥感影像建筑物提取(img_path=遥感图像路径, model_path=unet_模型路径, size=获取图像大小)  # -> seg_path; inputs img_path: list, model_path: list, size: list
#   port img_path: [required] - [type = int] - [default = None] Descripe your input here * bullet point. * bullet point
#   port seg_path: indicate your output description here. refers to a new line.
# ---------- 建筑物分割: Python ----------
# -*- coding: utf-8 -*-
import paddle
import paddleseg.transforms as T
import numpy as np
import cv2
import os

# save path 
dir, name = os.path.split(img_path)
save_dir = dir + '/output'
seg_path = save_dir + '/seg_' + name
# load model
inf_model = paddle.jit.load(model_path)
inf_model.eval()
# inf and save
transforms = T.Compose([
    T.Resize(target_size=(512, 512)),
    T.Normalize()
])
img, _ = transforms(img_path)
img = paddle.to_tensor(img[np.newaxis, :])
pre = inf_model(img)
pred = paddle.argmax(pre, axis=1).numpy().reshape((size, size))
cv2.imwrite(seg_path, pred)
# ---------- end 建筑物分割 ----------
Y = UnitY(Factor=expr("-x", 获取图像大小))
影像底图 = ImportImage(File=遥感图像路径)
move = Move(Geometry=影像底图, Motion=Y)  # -> Geometry, Transform
opencv处理与数据准备 = GH_CPython(
    img_path=建筑物分割,
    threshold_area=threshold_area,
    threshold_area_simplify=threshold_area_simplify,
    open_comput=list,
    open_kernel_size=open_kernel_size,
    h_min=h_min,
    h_max=h_max,
    zoom=zoom)  # -> bud_cons, bud_heis, con_nums; inputs img_path: list, threshold_area: list, threshold_area_simplify: list, open_comput: list, open_kernel_size: list, h_min: list, h_max: list, zoom: list
#   port img_path: [required] - [type = int] - [default = None] Descripe your input here * bullet point. * bullet point
# ---------- opencv处理与数据准备: Python ----------
# -*- coding: utf-8 -*-
#coding=utf-8
import cv2
import numpy as np
import os
import random

def build_extracter(
    img_path,
    threshold_area=200,
    threshold_area_simplify=5,
    open_comput=False,
    open_kernel_size=9
    ):
    img = cv2.imread(img_path, 0)
    cv_img = np.uint8(~(img.astype(bool)))
    if open_comput:
        kernel = cv2.getStructuringElement(cv2.MORPH_ELLIPSE, (open_kernel_size, open_kernel_size))
        cv_img = cv2.morphologyEx(cv_img, cv2.MORPH_OPEN, kernel)
    contours, _ = cv2.findContours(cv_img, cv2.RETR_LIST, cv2.CHAIN_APPROX_SIMPLE)
    bods = []
    for contour in contours:
        area = cv2.contourArea(contour)
        if area > threshold_area:
            out = cv2.approxPolyDP(contour, threshold_area_simplify, True)
            bods.append(out)
    return bods

boundary = build_extracter(
    img_path,
    threshold_area,
    threshold_area_simplify,
    open_comput,
    open_kernel_size
)

bud_cons = []
bud_heis = []
con_nums = []
for bd in boundary:
    con = bd.tolist()
    c_num = len(con)
    if c_num >= 3:  # not lines
        hei = random.uniform(h_min, h_max) * zoom
        bud_cons.append(con)
        bud_heis.append(hei)
        con_nums.append(c_num)
# ---------- end opencv处理与数据准备 ----------
建筑数据成模 = GhPythonScript(bud_cons=opencv处理与数据准备.bud_cons, bud_heis=opencv处理与数据准备.bud_heis, con_nums=opencv处理与数据准备.con_nums)  # -> out, builds, vectors; inputs bud_cons: list of Int32, bud_heis: list of Int32, con_nums: list of Int32
# ---------- 建筑数据成模: Python ----------
__author__ = "Geoyee"
__version__ = "2020.07.26"

import rhinoscriptsyntax as rs

buds = []
vets = []
index = 0
for i in range(len(con_nums)):
    con = []
    for j in range(0,2*con_nums[i],2):
        p = rs.AddPoint(bud_cons[index+j], -bud_cons[index+j+1], 0)
        con.append(p)
    con.append(con[0])
    index += 2*con_nums[i]
    bs = rs.AddPolyline(con)
    h_var = rs.VectorAdd(rs.AddPoint(0,0,0), rs.AddPoint(0,0,bud_heis[i]))
    vets.append(h_var)
    buds.append(bs)
builds = buds
vectors = vets
# ---------- end 建筑数据成模 ----------
srf = Surface(建筑数据成模.builds)
vec = Vector(建筑数据成模.vectors)
extr = Extrude(Base=srf, Direction=vec)
cap = CapHoles(Brep=extr)
